# Dynamo graph ByViewNameDivisionsGridBoundary.dyn (Dynamo 1.3.0.875)

code_block = CodeBlock { "test drafting view"; }
byName = DraftingView.ByName(code_block)
code_block_2 = CodeBlock { 200; }
surveyPoint = Coordinates.SurveyPoint()
basePoint = Coordinates.BasePoint()
ZAxis = Vector.ZAxis()
code_block_3 = CodeBlock { 20000; }
translate = Geometry.Translate(geometry=surveyPoint, direction=ZAxis, distance=code_block_3)
byViewNameDivisionsGridBoundary = Analyze.Daylighting.CloudDaylightingJob.ByViewNameDivisionsGridBoundary(byName, code_block_2, code_block_2, surveyPoint, basePoint, translate)  # unwired: arg6
select_skymodeltype = SkyModelTypeDropDown("CIEOvercast")
byTypeConstants = Analyze.Render.SkyModel.ByTypeConstants(select_skymodeltype)
code_block_4 = CodeBlock { 42.213; -71.033; }
today = DateTime.Today()
bySkyModelLocationDate = Analyze.Render.RenderingEnvironment.BySkyModelLocationDate(byTypeConstants, code_block_4.out0, code_block_4.out1, today)
siteLocation = SiteLocation()
watch = Watch(siteLocation)
