# Dynamo graph Color.dyn (Dynamo 1.3.1.1736)

code_block = CodeBlock { "{3D}"; }
code_block_2 = CodeBlock { 800; 600; }
select_rendertype = RenderTypeDropDown("Image")
select_renderquality = RenderQualityDropDown("Standard")
byViewNameWidthHeight = Analyze.Render.CloudRenderingJob.ByViewNameWidthHeight(code_block, code_block_2.out0, code_block_2.out1, select_rendertype, select_renderquality)
byViewNameDivisionsGridBoundary = Analyze.Daylighting.CloudDaylightingJob.ByViewNameDivisionsGridBoundary()  # unwired: arg0, arg1, arg2, arg3, arg4, arg5, arg6
