# Dynamo graph ToImage.dyn (Dynamo 1.3.1.1736)

file_path = Filename("..\..\..\..\..\..\..\..\..\..\..\Desktop\September 21st 9AM.sdf")
parse = Analyze.Daylighting.DaylightingResults.Parse(file_path)
toImage = Analyze.Daylighting.DaylightingResults.ToImage(parse)
