# Dynamo graph Do Cloud Render.dyn (Dynamo 1.3.1.1736)

code_block = CodeBlock { "{3D}"; }
export_cloud_render_data = ExportDocumentRenderData(code_block)
upload_cloud_render_data = UploadRenderData(export_cloud_render_data)
code_block_2 = CodeBlock { 150; }
levels = Levels("Level 1")
create = List.Create(levels)
all_elements_at_level = ElementsAtLevel(create)
code_block_3 = CodeBlock { "Floor"; }
removeIfNot = RemoveIfNot(arg1=code_block_3)  # unwired: arg0
map = List.Map(list=all_elements_at_level, f_x=removeIfNot)
geometry = Element.Geometry(map)
flatten = Flatten(geometry)
byGeometry = BoundingBox.ByGeometry(flatten)
maxPoint = BoundingBox.MaxPoint(byGeometry)
code_block_4 = CodeBlock(maxBB=maxPoint) { maxBB.X; maxBB.Y; maxBB.Z; }
minPoint = BoundingBox.MinPoint(byGeometry)
code_block_5 = CodeBlock(minBBZ=minPoint) { minBBZ.X; minBBZ.Y; minBBZ.Z; }
integer_slider = IntegerSlider(1500, range=0..2000 step 100)
bottom_left = CodeBlock(X=code_block_4.out0, Y=code_block_4.out1, Z=code_block_5.out2, simElev=integer_slider) { Point.ByCoordinates(X,Y,Z+simElev); }
bottom_right = CodeBlock(X=code_block_5.out0, Y=code_block_5.out1, Z=code_block_5.out2, simElev=integer_slider) { Point.ByCoordinates(X,Y,Z+simElev); }
top_left = CodeBlock(X=code_block_4.out0, Y=code_block_4.out1, Z=code_block_4.out2, simElev=integer_slider) { Point.ByCoordinates(X,Y,Z+simElev); }
select_skymodeltype = SkyModelTypeDropDown("Perez")
code_block_6 = CodeBlock { {51,82}; {360,522}; {259,329}; }
byTypeConstants = Analyze.Render.SkyModel.ByTypeConstants(select_skymodeltype, code_block_6.out0, code_block_6.out1, code_block_6.out2)
code_block_7 = CodeBlock { 42.213; -71.033; }
code_block_8 = CodeBlock { 9; 21; {9,15}; 5; }
byDateInformation = Analyze.Render.DateTime.ByDateInformation(code_block_8.out0, code_block_8.out1, arg3=code_block_8.out2, arg6=code_block_8.out3)
bySkyModelLocationDate = Analyze.Render.RenderingEnvironment.BySkyModelLocationDate(byTypeConstants, code_block_7.out0, code_block_7.out1, byDateInformation)
byViewNameDivisionsGridBoundary = Analyze.Daylighting.CloudDaylightingJob.ByViewNameDivisionsGridBoundary(code_block, code_block_2, code_block_2, bottom_left, bottom_right, top_left, bySkyModelLocationDate)
boolean = BoolSelector(false)
do_cloud_render = CloudRender(upload_cloud_render_data, byViewNameDivisionsGridBoundary, boolean)
