# Dynamo graph ByViewNameWidthHeight.dyn (Dynamo 1.3.1.1736)

code_block = CodeBlock { "{3D}"; }
export_cloud_render_data = ExportDocumentRenderData(code_block)
upload_cloud_render_data = UploadRenderData(export_cloud_render_data)
code_block_2 = CodeBlock { 800; 600; }
select_rendertype = RenderTypeDropDown("Image")
select_renderquality = RenderQualityDropDown("Standard")
byViewNameWidthHeight = Analyze.Render.CloudRenderingJob.ByViewNameWidthHeight(code_block, code_block_2.out0, code_block_2.out1, select_rendertype, select_renderquality)
boolean = BoolSelector(false)
do_cloud_render = CloudRender(upload_cloud_render_data, byViewNameWidthHeight, boolean)
