# Dynamo graph BySkyModelLocationDate.dyn (Dynamo 1.3.1.1736)

select_skymodeltype = SkyModelTypeDropDown("Perez")
code_block = CodeBlock { {51,82}; {360,522}; {259,329}; }
byTypeConstants = Analyze.Render.SkyModel.ByTypeConstants(select_skymodeltype, code_block.out0, code_block.out1, code_block.out2)
code_block_2 = CodeBlock { 42.213; -71.033; }
code_block_3 = CodeBlock { 9; 21; {9,15}; 5; }
byDateInformation = Analyze.Render.DateTime.ByDateInformation(code_block_3.out0, code_block_3.out1, arg3=code_block_3.out2, arg6=code_block_3.out3)
bySkyModelLocationDate = Analyze.Render.RenderingEnvironment.BySkyModelLocationDate(byTypeConstants, code_block_2.out0, code_block_2.out1, byDateInformation)
