# Dynamo graph CountFalse.dyn (Dynamo 1.3.1.1736)

boolean = BoolSelector(false)
boolean_2 = BoolSelector(true)
create = List.Create(boolean, boolean_2)
watch = Watch(create)
countFalse = CountFalse(watch)
watch_2 = Watch(countFalse)
create_2 = List.Create(boolean, boolean)
create_3 = List.Create(create, create_2)
watch_3 = Watch(create_3)
countFalse_2 = CountFalse(watch_3)
watch_4 = Watch(countFalse_2)
countFalse_3 = CountFalse(watch_3@L2)
watch_5 = Watch(countFalse_3)
watch_6 = Watch(create_2)
countFalse_4 = CountFalse(watch_6)
watch_7 = Watch(countFalse_4)
countFalse_5 = CountFalse(watch_3@L3)
watch_8 = Watch(countFalse_5)
