# Dynamo graph CountTrue.dyn (Dynamo 1.3.1.1736)

boolean = BoolSelector(false)
boolean_2 = BoolSelector(true)
create = List.Create(boolean, boolean_2)
watch = Watch(create)
countTrue = CountTrue(watch)
watch_2 = Watch(countTrue)
create_2 = List.Create(boolean, boolean)
create_3 = List.Create(create, create_2)
watch_3 = Watch(create_3)
countTrue_2 = CountTrue(watch_3)
watch_4 = Watch(countTrue_2)
countTrue_3 = CountTrue(watch_3@L2)
watch_5 = Watch(countTrue_3)
watch_6 = Watch(create_2)
countTrue_4 = CountTrue(watch_6)
watch_7 = Watch(countTrue_4)
countTrue_5 = CountTrue(watch_3@L3)
watch_8 = Watch(countTrue_5)
