# Dynamo graph BySurfaceColors - Ex 2.dyn (Dynamo 1.0.0.1180)

code_block = CodeBlock { Point.Origin(); Point.ByCoordinates(0,5,3); Point.ByCoordinates(0,10,0); }
byThreePoints = Arc.ByThreePoints(firstPoint=code_block.out0, secondPoint=code_block.out1, thirdPoint=code_block.out2)
toNurbsCurve = Curve.ToNurbsCurve(byThreePoints)
