# Dynamo graph ByBestFitThroughPoints - Ex 2.dyn (Dynamo 1.1.0.2093)

code_block = CodeBlock { 0..19..#39; }
byCoordinates = Point.ByCoordinates(x=code_block, y=code_block, lacing=CrossProduct)
ZAxis = Vector.ZAxis()
file_path = Filename("C:\Users\Ronnie Parsons\Desktop\Dynamo Example Files\_REFERENCE\samplebitmap.jpg")
fromPath = FileObject(file_path)  # "File.FromPath"
readFromFile = Image.ReadFromFile(fromPath)
code_block_2 = CodeBlock { 40; }
pixels = Image.Pixels(image=readFromFile, xSamples=code_block_2, ySamples=code_block_2)
red = Color.Red(pixels)
code_block_3 = CodeBlock(x=red) { x/100; }
translate = Geometry.Translate(geometry=byCoordinates, direction=ZAxis, distance=code_block_3)
byPoints = NurbsSurface.ByPoints(translate)
code_block_4 = CodeBlock { 0..19..#20; }
byCoordinates_2 = Point.ByCoordinates(x=code_block_4, y=code_block_4, lacing=CrossProduct)
code_block_5 = CodeBlock { 20; }
pixels_2 = Image.Pixels(image=readFromFile, xSamples=code_block_5, ySamples=code_block_5)
red_2 = Color.Red(pixels_2)
code_block_6 = CodeBlock(x=red_2) { x/100; }
translate_2 = Geometry.Translate(geometry=byCoordinates_2, direction=ZAxis, distance=code_block_6)
byPoints_2 = NurbsSurface.ByPoints(translate_2)
number_slider = DoubleSlider(1, range=0..1 step 1e-05)
number_slider_2 = DoubleSlider(0, range=0..1 step 1e-05)
pointAtParameter = Surface.PointAtParameter(surface=byPoints_2, u=number_slider, v=number_slider_2)
UVParameterAtPoint = Surface.UVParameterAtPoint(byPoints, pointAtParameter)
UVParameterAtPoint_2 = Surface.UVParameterAtPoint(byPoints_2, pointAtParameter)
isAlmostEqualTo = Analysis.AnalysisExtensions.IsAlmostEqualTo(UVParameterAtPoint, UVParameterAtPoint_2)
