# Dynamo graph IsUniscaledOrtho.dyn (Dynamo 1.3.1.1736)

origin = Point.Origin()
byOriginVectors = CoordinateSystem.ByOriginVectors(origin=origin)
code_block = CodeBlock { Point.ByCoordinates(1,2,0); }
code_block_2 = CodeBlock { 1; 1; }
byCoordinates = Vector.ByCoordinates(y=code_block_2.out0, z=code_block_2.out1)
byOriginNormal = Plane.ByOriginNormal(origin=code_block, normal=byCoordinates)
number_slider = DoubleSlider(1.6, range=0..10 step 0.1)
number_slider_2 = DoubleSlider(7.9, range=0..10 step 0.1)
number_slider_3 = DoubleSlider(2.2, range=0..10 step 0.1)
scale = CoordinateSystem.Scale(byOriginVectors, byOriginNormal, number_slider, number_slider_2, number_slider_3)
isUniscaledOrtho = CoordinateSystem.IsUniscaledOrtho(scale)
identity = CoordinateSystem.Identity()
isUniscaledOrtho_2 = CoordinateSystem.IsUniscaledOrtho(identity)
