# Dynamo graph Simplify.dyn (Dynamo 1.3.1.1736)

code_block = CodeBlock { 1..30..#20; Math.Sin(0..360..#20)*4; }
byCoordinates = Point.ByCoordinates(x=code_block.out0, y=code_block.out1)
byControlPoints = NurbsCurve.ByControlPoints(byCoordinates)
number_slider = DoubleSlider(0.001, range=0.001..100 step 0.001)
simplify = Curve.Simplify(byControlPoints, number_slider)
