# Dynamo graph ByPointsTangents.dyn (Dynamo 1.3.1.1736)

code_block = CodeBlock { 0..10..#3; }
code_block_2 = CodeBlock(x=code_block) { x*2; }
byCoordinates = Point.ByCoordinates(x=code_block_2, y=code_block_2, lacing=CrossProduct)
code_block_3 = CodeBlock { 1; }
code_block_4 = CodeBlock { 2..2..#400; }
byCoordinates_2 = Vector.ByCoordinates(x=code_block_3, y=code_block_3, z=code_block_4)
byPointsTangents = NurbsSurface.ByPointsTangents(byCoordinates, byCoordinates_2, byCoordinates_2, byCoordinates_2, byCoordinates_2)
