# Dynamo graph ByViewFacePointsAndValues.dyn (Dynamo 1.3.1.1736)

views = Views("{3D}")
select_face = DSFaceSelection()  # 1 picked in the model
code_block = CodeBlock { 0..1..#5; }
byCoordinates = UV.ByCoordinates(code_block, code_block, lacing=CrossProduct)
flatten = Flatten(byCoordinates)
code_block_2 = CodeBlock { 0..10..#25; }
code_block_3 = CodeBlock { "test"; "this is a test"; }
unit_types = UnitTypes("Insolation")
byViewFacePointsAndValues = Revit.AnalysisDisplay.FaceAnalysisDisplay.ByViewFacePointsAndValues(views, select_face, flatten, code_block_2, code_block_3.out0, code_block_3.out1, unit_types)
