# Dynamo graph ByViewPointsAndValues.dyn (Dynamo 1.3.1.1736)

views = Views("{3D}")
select_face = DSFaceSelection()  # 1 picked in the model
code_block = CodeBlock { 0..1..#25; }
pointAtParameter = Surface.PointAtParameter(surface=select_face, u=code_block, v=code_block, lacing=CrossProduct)
flatten = Flatten(pointAtParameter)
code_block_2 = CodeBlock { 0..10..#625; }
code_block_3 = CodeBlock { "test"; "this is a test"; }
unit_types = UnitTypes("Insolation")
byViewPointsAndValues = Revit.AnalysisDisplay.PointAnalysisDisplay.ByViewPointsAndValues(views, flatten, code_block_2, code_block_3.out0, code_block_3.out1, unit_types)
