# Dynamo graph ByViewPointsAndVectorValues.dyn (Dynamo 1.3.1.1736)

views = Views("{3D}")
select_face = DSFaceSelection()  # 1 picked in the model
code_block = CodeBlock { 0..1..#25; }
pointAtParameter = Surface.PointAtParameter(surface=select_face, u=code_block, v=code_block, lacing=CrossProduct)
flatten = Flatten(pointAtParameter)
normalAtParameter = Surface.NormalAtParameter(surface=select_face, u=code_block, v=code_block, lacing=CrossProduct)
flatten_2 = Flatten(normalAtParameter)
code_block_2 = CodeBlock { 0..1..#625; }
scale = Vector.Scale(vector=flatten_2, scale_factor=code_block_2)
code_block_3 = CodeBlock { "test"; "this is a test"; }
unit_types = UnitTypes("Insolation")
byViewPointsAndVectorValues = Revit.AnalysisDisplay.VectorAnalysisDisplay.ByViewPointsAndVectorValues(views, flatten, scale, code_block_3.out0, code_block_3.out1, unit_types)
