# Dynamo graph Height.dyn (Dynamo 1.2.1.3083)

# group: Revit sample file: rac_basic_sample_project.rvt
# note: This Dynamo example file has been created with the basic sample project in the Revit installation directory, typically found in:
# C:\Program Files\Autodesk\Revit 2017\Samples

categories = Categories("CurtainWallPanels")
all_elements_of_category = ElementsOfCategory(categories)
isRectangular = CurtainPanel.IsRectangular(all_elements_of_category)
filterByBoolMask = List.FilterByBoolMask(list=all_elements_of_category, mask=isRectangular)
height = CurtainPanel.Height(filterByBoolMask.in)
