# Dynamo graph ByFace.dyn (Dynamo 1.3.0.875)

origin = Point.Origin()
code_block = CodeBlock { 2000; }
byCenterPointRadiusAngle = Arc.ByCenterPointRadiusAngle(center=origin, radius=code_block)
ZAxis = Vector.ZAxis()
code_block_2 = CodeBlock { 2000; }
extrude = Curve.Extrude(curve=byCenterPointRadiusAngle, direction=ZAxis, distance=code_block_2)
element_types = ElementTypes("CurtainSystemType")
all_elements_of_type = ElementsOfType(element_types)
byFace = CurtainSystem.ByFace(extrude, all_elements_of_type)
code_block_3 = CodeBlock { 1000; }
levels = Levels("Level 1")
wall_types = WallTypes("Curtain Wall 1")
byCurveAndHeight = Wall.ByCurveAndHeight(height=code_block_3, level=levels, wallType=wall_types)  # unwired: curve
faces = Element.Faces(byCurveAndHeight)
byGeometry = ImportInstance.ByGeometry(extrude)
faces_2 = Element.Faces(byGeometry)
