# Dynamo graph LocationCurve.dyn (Dynamo 1.2.1.3083)

# group: Revit sample file: rac_basic_sample_project.rvt
# note: This Dynamo example file has been created with the basic sample project in the Revit installation directory, typically found in:
# C:\Program Files\Autodesk\Revit 2017\Samples

select_model_element = DSModelElementSelection()  # 1 picked in the model
byElement = CurtainPanel.ByElement(select_model_element)
supportingMullions = CurtainPanel.SupportingMullions(byElement)
locationCurve = Mullion.LocationCurve(supportingMullions)
