# Dynamo graph Points.dyn (Dynamo 1.3.0.875)

code_block = CodeBlock { 500; }
byWidthLength = Rectangle.ByWidthLength(width=code_block, length=code_block)
curves = PolyCurve.Curves(byWidthLength)
element_types = ElementTypes("RoofType")
all_elements_of_type = ElementsOfType(element_types)
code_block_2 = CodeBlock { 0; }
getItemAtIndex = List.GetItemAtIndex(list=all_elements_of_type, index=code_block_2)
levels = Levels("Level 2")
byOutlineTypeAndLevel = Roof.ByOutlineTypeAndLevel(outline=curves, roofType=getItemAtIndex, level=levels)
points = Roof.Points(byOutlineTypeAndLevel)
byName = RoofType.ByName()  # unwired: arg0
