# Dynamo graph All Elements at Level.dyn (Dynamo 1.2.1.3083)

# group: Open with Revit file: rac_basic_sample_project.rvt
# note: The Revit sample file can be found in Revit's installation directory, typically located in:
# C:\Program Files\Autodesk\Revit 2017\Samples

levels = Levels("Level 2")
all_elements_at_level = ElementsAtLevel(levels)
watch = Watch(all_elements_at_level)
