# Dynamo graph All Elements of Category.dyn (Dynamo 1.2.1.3083)

# group: Open with Revit file: rac_basic_sample_project.rvt
# note: The Revit sample file can be found in Revit's installation directory, typically located in:
# C:\Program Files\Autodesk\Revit 2017\Samples

categories = Categories("StructuralColumns")
all_elements_of_category = ElementsOfCategory(categories)
watch = Watch(all_elements_of_category)
