# Dynamo graph All Elements of Type.dyn (Dynamo 1.2.1.3083)

# group: Open with Revit file: rac_basic_sample_project.rvt
# note: The Revit sample file can be found in Revit's installation directory, typically located in:
# C:\Program Files\Autodesk\Revit 2017\Samples

element_types = ElementTypes("Wall")
all_elements_of_type = ElementsOfType(element_types)
watch = Watch(all_elements_of_type)
