# Dynamo graph Get Family Parameter.dyn (Dynamo 1.2.1.3083)

# group: Open with Revit file: rac_basic_sample_project.rvt
# note: The Revit sample file can be found in Revit's installation directory, typically located in:
# C:\Program Files\Autodesk\Revit 2017\Samples

family_types = FamilyTypes("Curtain Wall Dbl Glass:Curtain Wall Dbl Glass")
get_family_parameter = FamilyInstanceParameters("Offset(Type)(double)", family_types)
watch = Watch(get_family_parameter)
