# Dynamo graph Select Divided Surface Families.dyn (Dynamo 1.2.1.3083)

# group: Revit sample file: rac_basic_sample_project.rvt
# note: This Dynamo example file has been created with the basic sample project in the Revit installation directory, typically found in:
# C:\Program Files\Autodesk\Revit 2017\Samples

family_types = FamilyTypes("M_Pile Cap-600 Pile:600 x 600 x 900mm")
get_family_parameter = FamilyInstanceParameters("Length(Type)(double)", family_types)
select_divided_surface_families = DSDividedSurfaceFamiliesSelection()
