# Dynamo graph ByNameNumberTitleBlockAndViews.dyn (Dynamo 1.2.1.3083)

# group: Open with Revit file: rac_basic_sample_project.rvt
# note: The Revit sample file can be found in Revit's installation directory, typically located in:
# C:\Program Files\Autodesk\Revit 2017\Samples

code_block = CodeBlock { "Renderings"; }
code_block_2 = CodeBlock { "A200"; }
family_types = FamilyTypes("A1 metric:A1 metric")
views = Views("From Yard")
byNameNumberTitleBlockAndViews = Sheet.ByNameNumberTitleBlockAndViews(code_block, code_block_2, family_types, views)
